# Grasshopper definition OpenspaceAutomation.gh (Grasshopper 1.0.8)

# ---- group: 1168010100108260014 Lot Region
필지 = Geometry(<curve referenced from the Rhino model>)

# ---- group: Road Region
도로 = Geometry([<curve referenced from the Rhino model> x11])

# ---- group: Building Region
geometry = Geometry([<curve referenced from the Rhino model> x2])

# ---- group: Parking Region
geometry_2 = Geometry(<curve referenced from the Rhino model>)

# ----
python_3_script = Python3Script(script=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, lot_region=필지, road_regions=도로, building_regions=geometry, parking_region=geometry_2)  # -> out, openspace_regions; inputs lot_region: Curve, road_regions: list of Curve, building_regions: list of Curve, parking_region: Curve; unedited script template
boundary_surfaces = BoundarySurfaces(Edges=python_3_script.openspace_regions)
panel = Panel(python_3_script.out)
